# Grasshopper definition assignment3.gh (Grasshopper 0.9.76)
# Copyright: All rights reserved
# plug-ins: Python Interpreter, SlingshotDB

# ----
# Point Cloud (PC) input
id = Guid(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)
# Input
c_script = CSharpScript(
    id=id,
    Reference="C:\Users\Balázs\Documents\GEO1004_3D\MathNet.Numerics-3.4.0\MathNet.Numerics\Net40\MathNet.Numerics.dll")  # -> out, P, N, C; inputs id: Guid
# ---------- c_script: C# ----------
    object obj = RhinoDocument.Objects.Find(id);
    if (obj == null)
      return;

    Rhino.DocObjects.PointCloudObject cloudObject = obj as Rhino.DocObjects.PointCloudObject;
    if (cloudObject == null)
      return;
    PointCloud cloud = cloudObject.PointCloudGeometry;

    List<Point3d> points = new List<Point3d>();
    List<Vector3d> normals = null;
    List<Color> colours = null;

    if (cloud.ContainsNormals)
      normals = new List<Vector3d>();
    if (cloud.ContainsColors)
      colours = new List<Color>();

    foreach (PointCloudItem item in cloud)
    {
      points.Add(item.Location);

      if (normals != null)
        normals.Add(item.Normal);
      if (colours != null)
        colours.Add(item.Color);
    }

    P = points;
    N = normals;
    C = colours;
# ---------- end c_script ----------

# ---- group: make a suitable connection string
pgstring = PostgreSQLConnectionString(
    Server="localhost",
    Port="5432",
    UserID="postgres",
    Password="postgres",
    Database="geo1004_3",
    CommandTimeout="20",
    ConnnectionTimeout="5")
patch = VBScript(CString=pgstring)  # -> out, A
# ---------- patch: VB ----------
    '   Patch developed by MSc Geomatics, Rusne Sileryte, in June 2014

    Dim CSList() As  String
    CSList = Cstring.Split(";")
    CSlist(0) = "Driver={PostgreSQL ODBC Driver(UNICODE)}"
    Dim CS As String
    CS = String.Join(";", CSlist)
    A = CS
# ---------- end patch ----------

# ----
create_db_tables = Panel("""CREATE TABLE IF NOT EXISTS pointcloud(id int not null, point geometry, seg_id int, primary key(id));
CREATE TABLE IF NOT EXISTS planes(id int not null, origin geometry, n_x geometry, n_y geometry, n_z geometry, segment int, primary key(id));
CREATE TABLE IF NOT EXISTS building(id int not null, primary key(id));
CREATE TABLE IF NOT EXISTS buildingpart(id int not null, primary key(id));
CREATE TABLE IF NOT EXISTS roofsurface(id int not null, segment int, primary key(id));
CREATE TABLE IF NOT EXISTS wallsurface(id int not null, segment int, primary key(id));
CREATE TABLE IF NOT EXISTS groundsurface(id int not null, segment int, primary key(id));""")

# ----
# Subset the points in the PC for quick calculations in tests.
nr_of_points = Slider(200, range=0..4000)
# TOIDAR:
# The average curvature in the red box is maybe a good reference for a good Cthreshold. If it is not possible to find a good result with these parameters, adjust the search for neighbours.
filtering = BooleanToggle(False)
subset_points = PythonScript(x=c_script.P, range=nr_of_points, switch=filtering)  # -> out, a; inputs x: list, range: Int32
# ---------- subset_points: Python ----------
if switch:
    a = x[0:range]
else:
    a = x
print x[0]
# ---------- end subset_points ----------

curvature_threshold = Slider(0.01, range=0..0.5)
angle_threshold = Slider(4, range=0..45)
cstring = Text(patch.A)
k = Slider(40, range=1..50)

# ----
# Normal and curvature
# estimates
R = Slider(0.5, range=0..5)
fdn = PythonScript(PC=subset_points.a, R=R)  # -> out, a; inputs PC: list of Point3d; disabled
# ---------- fdn: Python ----------
#=========
# Create Fixed Distance Neighbourhoods
#=========

def getNeighboursInRange(PC, R):
    """
    Get the neighbours in range R
    Input:
        PC: point cloud as list of points (Point3d)
        R: the range/radius (float)
    Output:
        list: list: [reference point, pt_1, pt_2, ..., pt_k]
    """
    # create a list of lists of points+neihborhoods as [[point_n, neighbors],[],...]
    FDN_list = [[] for x in xrange(len(PC))]
    for pt in range(len(PC)):
        p = PC[pt]
        # first element in the sublist is the reference point in the neihborhood
        neighbours = []
        for p2 in range(len(PC)):
            # calculate distance for each point in PC
            if p.DistanceTo(PC[p2]) < R:
                neighbours.append((PC[p2], p2))
        # the following elements are the neighbors
        [FDN_list[pt].append(i) for i in neighbours]
    return FDN_list
   

FDN_list = getNeighboursInRange(PC,R)
print FDN_list[0]
a = FDN_list
# ---------- end fdn ----------

# ---- group: First
toggle = BooleanToggle(True)

# ----
odbccommand = ODBCCommand(ConnectionString=cstring, ConnectToggle=toggle, Command=create_db_tables)
panel = Panel(odbccommand)
knn = PythonScript(PC=subset_points.a, k=k)  # -> out, a; inputs PC: list of Point3d, k: Int32
# ---------- knn: Python ----------
import operator

"""
Reference: http://machinelearningmastery.com/tutorial-to-implement-k-nearest-neighbors-in-python-from-scratch/
"""
def getNeighbors(PC, point, k):
    """
    Calculates the k-Nearest Neighbours(k) for each point(point) in a point cloud(PC)
    Input: 
        PC: Point Cloud as list of points (Point3d )
        point: a single reference point (Point3d)
        k: number of points in the neihborhood
    Output:
        list: [reference point, pt_1, pt_2, ..., pt_k]
    """
    distances = []
    for pt in range(len(PC)):
        dist = point.DistanceTo(PC[pt])
        distances.append((PC[pt], dist, pt))
    # sort the distances in ascending order
    distances.sort(key=operator.itemgetter(1)) 
    neighbors = []
    for x in range(k):
        # retrieve the shortest distance
        neighbors.append((distances[x][0], distances[x][2]))
    return neighbors

# create a list of lists of points+neihborhoods as [[point_n, neighbors],[],...]   
kNN_list = [[] for x in xrange(len(PC))] 
for point in range(len(PC)):
    # first element in the sublist is the reference point in the neihborhood
    #kNN_list[point].append((PC[point],point))
    neighbors = getNeighbors(PC, PC[point], k)
    # the following elements are the neighbors
    [kNN_list[point].append(i) for i in neighbors]
    
a = kNN_list
# ---------- end knn ----------
norm_curv = PythonScript(neighbors=knn.a)  # -> out, N, Cur, Pt; inputs neighbors: list
# ---------- norm_curv: Python ----------
import clr
clr.AddReference("mtrand")

import math
import operator 
import numpy as np
from numpy import linalg as LA
import Rhino.Geometry as RG

#=======================
# Estimation of normals
#=======================
covM = [] # the list of covariance matrices
#point_a = np.empty([len(neighbors[0]),3]) # a single empty array shaped as an input for the covariance matrix

for Pgroup in range(len(neighbors)):
    point_a = np.empty([len(neighbors[Pgroup]),3])
    #print 'this is the structure of the coordinate matrix per neighbourhood: ' + str(point_a)
    for point in range(len(neighbors[Pgroup])):
        #print neighbors[Pgroup][point]
        #print 'this is point: ' + str(point) + ' before coordinate insertion'
        #print str(point_a[point])
        point_a[point][0] = neighbors[Pgroup][point][0][0] # X
        #print str(neighbors[Pgroup][point][0])
        #print str(neighbors[Pgroup][point][0][0])
        #print str(neighbors[Pgroup][point][0][1])
        #print str(neighbors[Pgroup][point][0][2])
        point_a[point][1] = neighbors[Pgroup][point][0][1] # Y
        point_a[point][2] = neighbors[Pgroup][point][0][2] # Z
        #print 'this is point: ' + str(point) + ' after coordinate insertion'
        #print str(point_a[point]) 
    #print point_a
    m = np.cov(point_a, rowvar=0) #each column represents a variable, while the rows contain observations
    #print m
    covM.append(m)

normals = []
curvature = []
#index = 0
for m in range(len(neighbors)):
   # calculate eigenvalues (e_vals) and eigenvectors (e_vecs)
   e_vals, e_vecs = LA.eig(covM[m])
   #print e_vals, e_vecs
   # get the index of the smallest eigenvalue
   eMin = np.argmin(e_vals)
   # calculate curvature at point
   c = e_vals[eMin]/sum(e_vals)
   curvature.append(c)
   # retrieve the smallest eigenvector corresponding to the smallest eigenvalue
   normal = e_vecs[:,eMin]
   # cast normal coordinates into floats
   normal = [float(i) for i in normal]
   # create a Vector3d from each normal
   normals.append([neighbors[m],RG.Vector3d(normal[0],normal[1],normal[2]),c])

# curvature list output for visualizing them
Cur = [float(i) for i in curvature]

#=======================
# Check if the direction of the normals are in align with the point of origin of the LIDAR laser beam
Z = RG.Vector3d(0,0,1)
normals_copy = normals[:]
for i in range(len(normals_copy)):
    v = normals_copy[i][1]
    # unitize normals
    v.Unitize()
    # compute dot product of Z unit vector and normal
    dp = RG.Vector3d.Multiply(Z,v) 
    if dp < 0.0:
        # if dot product negative, reverse vector
        normals[i][1].Reverse()

# normal list output for visualizing them
x=[]
for i in normals:
    x.append(i[-2])
N=x

Pt = normals
# ---------- end norm_curv ----------
avr = Average(Input=norm_curv.Cur)
panel_2 = Panel(avr)
region_growing = PythonScript(PC=norm_curv.Pt, cTh=curvature_threshold, aTh=angle_threshold)  # -> out, seg_ID, nr_seg, seg_3d; inputs PC: list
# ---------- region_growing: Python ----------
import Rhino.Geometry as RG
from collections import deque
import math
import copy

# Create a point dictionary for quick access as: 
# {Reference point(ID): [Ref_geometry(Point3d), Ref_curvature(Float), Ref_normal(Vector3d),[list of neighbors(ID)]]}
PC_dict = dict()
for i in range(len(PC)):
    n_list = []
    for j in PC[i][0][1:]:
        n_list.append(j[1])
    PC_dict[PC[i][0][0][1]] = [PC[i][0][0][0], PC[i][2], PC[i][1], n_list]

"""
About Rhino GUID in Grasshopper:
"After any manipulation, of the originally referenced Point from Rhino, it will 
loose the Guid and subsequently other Rhino informations and it`s pretty hard to 
find the right guid again. So i would try to keep your Guid from the beginning in 
your script."
http://www.grasshopper3d.com/forum/topics/guid-of-an-object
"""
"""
Region growing algorithm for point cloud segmentation. 
Implementaion of the algorithm from here:
http://pointclouds.org/documentation/tutorials/region_growing_segmentation.php
Input:
    PC: List(Point3d). Point Cloud as list of points.
    N: List(Vector3d). Normal vectors as list of vectors.
    c: List(Float). Curvature estimates for each point.
    cTh: Float. Curvature threshold.
    aTh: Float. Angle threshold in degrees.
Output:
    R_list: List(Point3d). Region list.    
"""
R_list = [] # Region list
PC_cp = copy.deepcopy(PC_dict)
    
while len(PC_cp) > 0:
    Rc = []
    Sc = []
    Pmin = min(PC_cp, key=PC_cp.get)
    Rc.append(Pmin)
    Sc = deque([Pmin]) # create a queue (FIFO structure)
    print 'Initiated seed list: ' + str(Sc[0])
    while len(Sc) > 0:
        Bc = PC_cp[Sc[0]][3]
        print 'initiated neighbourhood '+str(Bc)+' for seed '+str(Sc[0])
        for j in Bc:
            if PC_cp.has_key(j):
                v1,v2 = PC_cp[Sc[0]][2],PC_cp[j][2]
                # check if angle difference 1.0 indicate identical points
                if RG.Vector3d.VectorAngle(v1, v2) * (180/math.pi) < aTh:
                #if RG.Vector3d.Multiply(v1,v2) > aTh:
                    Rc.append(j) # optionally also append Vector3d
                    if PC_cp[j][1] < cTh:
                        if j not in Sc:
                            Sc.append(j)
                            print str(j)+' added to seed list'
                    #del PC_cp[j]
                    #print str(j)+' deleted from PC_cp'
        print 'removing '+str(Sc[0])+' from PC_cp'
        del PC_cp[Sc[0]]
        print 'removing '+str(Sc[0])+' from seed list'
        Sc.popleft()
        print 'new seed list is: ' + str(Sc)
    R_list.append(Rc)

# output only the point IDs for the respective segment
seg_ID = R_list
# number of segments for quick check
nr_seg = len(R_list)

# output segment-points as Point3d
segment = []
for seg in R_list:
    segment.append([PC_dict[ref_id][0] for ref_id in seg])
seg_3d = segment
# ---------- end region_growing ----------
nr_of_segments = Panel(region_growing.nr_seg)
roof_to_db = PythonScript()  # -> out; inputs roof: list
# ---------- roof_to_db: Python ----------
cmd_line = "INSERT INTO roofsurface(id, segment) VALUES("+id+", "+segment+");"
# ---------- end roof_to_db ----------
planes = PythonScript(PC=norm_curv.Pt, seg_ID=region_growing.seg_ID, cTh=Slider(0.01, range=0..0.1))  # -> out, planes, points, points_ID, o, n; inputs PC: list, seg_ID: list
# ---------- planes: Python ----------
import Rhino.Geometry as RG
from Grasshopper import DataTree
from Grasshopper.Kernel.Data import GH_Path

# Create a point dictionary for quick access as: 
# {Reference point(ID): [Ref_geometry(Point3d), Ref_curvature(Float), Ref_normal(Vector3d),[list of neighbors(ID)]]}
PC_dict = dict()
for i in range(len(PC)):
    n_list = []
    #print PC[i]
    for j in PC[i][0][1:]:
        n_list.append(j[1])
    PC_dict[PC[i][0][0][1]] = [PC[i][0][0][0], PC[i][2], PC[i][1], n_list]

# =======================
# Sort faces from corners and create planes
# =======================
pts = []
pts_ID = []
pls = []
idx = 0
for segment in seg_ID:
    # segments that have less than 3 points are discarded
    if len(segment) >= 3:
        # Get average curvature of the segment
        cur = [PC_dict[pt][1] for pt in segment]
        cur = sum(cur)/len(cur)
        # If the the avg. curvature is below the threshold, thus it is planar
        # and represents a face not a corner, create a plane.
        if cur < cTh:
            tmp = [PC_dict[pt][0] for pt in segment]
            pl = RG.Plane.FitPlaneToPoints(tmp)[1]
            #o,n = pls.Origin, pls.Normal
            pls.append(pl)
            pts.append(tmp)
            pts_ID.append((idx,segment))
            idx += 1
            #points = [PC_dict[pt][0] for pt in segment]
            #planes = RG.Plane.FitPlaneToPoints(tmp)[1]
        else:
            continue
    else:
        continue

#o = len(pls)

planes = pls

tree_pts = DataTree[object]()
for i in range(len(pts)):
    temp = pts[i]
    path = GH_Path(i)
    tree_pts.AddRange(temp, path)
points = tree_pts

points_ID = pts_ID
# ---------- end planes ----------

plane_to_db = PythonScript(plane=planes.planes, segment=planes.points_ID)  # -> out; inputs plane: list, segment: list
# ---------- plane_to_db: Python ----------
for n,i in enumerate(plane):
    id = str(n)
    origin = str(i.Origin)
    n_x = str(i.XAxis)
    n_y = str(i.YAxis)
    n_z = str(i.ZAxis)
    segment = str(n)
    cmd_line = "INSERT INTO planes(id, origin, n_x, n_y, n_z, segment) VALUES("+id+", ST_MakePoint("+origin+"), ST_MakePoint("+n_x+"), ST_MakePoint("+n_y+"), ST_MakePoint("+n_z+"), "+segment+");"
    print cmd_line
# ---------- end plane_to_db ----------
seg_to_db = PythonScript(segment=planes.points_ID)  # -> out; inputs segment: list
# ---------- seg_to_db: Python ----------
for i in segment:
    id = str(i[0]) # segment id
    for k in i[1]:
        pt = str(k) # point id in the segment
        cmd_line = "UPDATE pointcloud SET seg_id="+id+" WHERE id="+pt+";"
        print cmd_line
# ---------- end seg_to_db ----------
pc_to_db = PythonScript(PC=norm_curv.Pt)  # -> out; inputs PC: list
# ---------- pc_to_db: Python ----------
for i in range(len(PC)):
    id = str(PC[i][0][0][1])
    pt = str(PC[i][0][0][0])
    cmd_line = "INSERT INTO pointcloud(id, point) VALUES("+id+" ,ST_MakePoint("+pt+"));"
    print cmd_line

cmd_line = "CREATE UNIQUE INDEX pc_idx ON pointcloud (id);"
print cmd_line
# ---------- end pc_to_db ----------
odbccommand_2 = ODBCCommand(ConnectionString=cstring, ConnectToggle=Button(), Command=pc_to_db)
odbccommand_3 = ODBCCommand(ConnectionString=cstring, ConnectToggle=Button(), Command=seg_to_db)
odbccommand_4 = ODBCCommand(ConnectionString=cstring, ConnectToggle=Button(), Command=plane_to_db)
panel_3 = Panel(odbccommand_2)
panel_4 = Panel(odbccommand_3)
panel_5 = Panel(odbccommand_4)

odbccommand_5 = ODBCCommand(ConnectionString=cstring, ConnectToggle=Button(), Command=roof_to_db)
dom = ConstructDomain(DomainStart=Slider(0, range=0..20), DomainEnd=Slider(15, range=0..20))
knn_2 = PythonScript(k=Slider(40, range=1..50))  # -> out, a, N, Cur, Pt; inputs PC: list of Point3d, k: Int32
# ---------- knn_2: Python ----------
"""
Reference: http://machinelearningmastery.com/tutorial-to-implement-k-nearest-neighbors-in-python-from-scratch/
"""
import clr
clr.AddReference("mtrand")

import math
import operator 
import numpy as np
from numpy import linalg as LA
import Rhino.Geometry as RG

def getNeighbors(PC, point, k):
    """
    Calculates the k-Nearest Neighbours(k) for each point(point) in a point cloud(PC)
    Input: 
        PC: Point Cloud as list of points (Point3d )
        point: a single reference point (Point3d)
        k: number of points in the neihborhood
    Output:
        list: [reference point, pt_1, pt_2, ..., pt_k]
    """
    distances = []
    for pt in range(len(PC)):
        dist = point.DistanceTo(PC[pt])
        distances.append((PC[pt], dist, pt))
    # sort the distances in ascending order
    distances.sort(key=operator.itemgetter(1)) 
    neighbors = []
    for x in range(k):
        # retrieve the shortest distance
        neighbors.append((distances[x][0], distances[x][2]))
    return neighbors

# create a list of lists of points+neihborhoods as [[point_n, neighbors],[],...]   
kNN_list = [[] for x in xrange(len(PC))] 
for point in range(len(PC)):
    # first element in the sublist is the reference point in the neihborhood
    #kNN_list[point].append((PC[point],point))
    neighbors = getNeighbors(PC, PC[point], k)
    # the following elements are the neighbors
    [kNN_list[point].append(i) for i in neighbors]
    
a = kNN_list
#print kNN_list[0]

#=======================
# Estimation of normals
#=======================
covM = [] # the list of covariance matrices
#point_a = np.empty([len(kNN_list[0]),3]) # a single empty array shaped as an input for the covariance matrix

for Pgroup in range(len(kNN_list)):
    point_a = np.empty([len(kNN_list[Pgroup]),3])
    #print 'this is the structure of the coordinate matrix per neighbourhood: ' + str(point_a)
    for point in range(len(kNN_list[Pgroup])):
        #print kNN_list[Pgroup][point]
        #print 'this is point: ' + str(point) + ' before coordinate insertion'
        #print str(point_a[point])
        point_a[point][0] = kNN_list[Pgroup][point][0][0] # X
        #print str(kNN_list[Pgroup][point][0])
        #print str(kNN_list[Pgroup][point][0][0])
        #print str(kNN_list[Pgroup][point][0][1])
        #print str(kNN_list[Pgroup][point][0][2])
        point_a[point][1] = kNN_list[Pgroup][point][0][1] # Y
        point_a[point][2] = kNN_list[Pgroup][point][0][2] # Z
        #print 'this is point: ' + str(point) + ' after coordinate insertion'
        #print str(point_a[point]) 
    #print point_a
    m = np.cov(point_a, rowvar=0) #each column represents a variable, while the rows contain observations
    #print m
    covM.append(m)

normals = []
curvature = []
#index = 0
for m in range(len(kNN_list)):
   # calculate eigenvalues (e_vals) and eigenvectors (e_vecs)
   e_vals, e_vecs = LA.eig(covM[m])
   #print e_vals, e_vecs
   # get the index of the smallest eigenvalue
   eMin = np.argmin(e_vals)
   # calculate curvature at point
   c = e_vals[eMin]/sum(e_vals)
   curvature.append(c)
   # retrieve the smallest eigenvector corresponding to the smallest eigenvalue
   normal = e_vecs[:,eMin]
   # cast normal coordinates into floats
   normal = [float(i) for i in normal]
   # create a Vector3d from each normal
   normals.append([kNN_list[m],RG.Vector3d(normal[0],normal[1],normal[2]),c])

# curvature list output for visualizing them
Cur = [float(i) for i in curvature]

#=======================
# Check if the direction of the normals are in align with the point of origin of the LIDAR laser beam
Z = RG.Vector3d(0,0,1)
normals_copy = normals[:]
for i in range(len(normals_copy)):
    v = normals_copy[i][1]
    # unitize normals
    v.Unitize()
    # compute dot product of Z unit vector and normal
    dp = RG.Vector3d.Multiply(Z,v) 
    if dp < 0.0:
        # if dot product negative, reverse vector
        normals[i][1].Reverse()

# normal list output for visualizing them
x=[]
for i in normals:
    x.append(i[-2])
N=x

Pt = normals
# ---------- end knn_2 ----------
planesrf = PlaneSurface(Plane=planes.planes, XSize=dom, YSize=dom)  # disabled
del = DelaunayMesh(Points=planes.points, Plane=planes.planes)  # disabled
panel_6 = Panel(planes.planes)
panel_7 = Panel(odbccommand_5)

# ----
# Visualization
curvature = Number(norm_curv.Cur)
N = Numbers(curvature)
bnd = Bounds(Numbers=N)
de = DeconstructDomain(Domain=bnd)  # -> Start, End
gradient = Gradient(LowerLimit=de.Start, UpperLimit=de.End, Parameter=N, stops=[0: RGB(0, 128, 0), 0.5: RGB(255, 255, 0), 1: RGB(255, 0, 0)])
curvature_2 = CustomPreview(Geometry=subset_points.a, Shader=gradient)

# ---- group: Visualize point neighborhoods
point_nr = Slider(105, range=0..1000)
point_size = Slider(0.1, range=0..0.1)
i = Integer(point_nr)
python = PythonScript(x=norm_curv.N, i=i)  # -> out, A; inputs x: list
# ---------- python: Python ----------
points = x[i]
A = points
# ---------- end python ----------
item = ListItem(List=subset_points.a, Index=i, Wrap=True)
dots = DotDisplay(Point=python.A, Colour=RGB(0, 0, 0), Size=point_size)
ln = Line(StartPoint=item, EndPoint=python.A)
dots_2 = DotDisplay(Point=item, Colour=RGB(255, 110, 110), Size=point_size)

# ----
select_segment = PythonScript(x=region_growing.seg_3d, y=Slider(78, range=0..94))  # -> out, a; inputs x: list, y: Int32; disabled
# ---------- select_segment: Python ----------
a = x[y]
# ---------- end select_segment ----------

# ---- group: Visualize normals
short = ShortestList(ListA=subset_points.a, ListB=norm_curv.N, TrimMode=2)  # -> ListA, ListB
vdis = VectorDisplay(Anchor=short.ListA, Vector=short.ListB)

# ----
dots_3 = DotDisplay(Point=select_segment.a, Colour=RGB(42, 88, 177), Size=point_size)  # disabled
